# Grasshopper definition Example_AllClasses.gh (Grasshopper 1.0.7)
# plug-ins: HAL for Grasshopper

sessionsettings = SessionSettings()  # -> Data, DefaultSettings
trigger = Trigger(Interval=20, TimerInterval=20, Target=c_script)
c_script = CSharpScript(
    reset=Button(),
    xBound=Slider(600, range=0..1000),
    yBound=Slider(300, range=0..1000),
    Reference="C:\Users\Leo\source\repos\TreasureHunt\Library\bin\Debug\net4.8\TreasureHunt - Copie.dll")  # -> out, A, hbX, hbY, outputPlayerLoc, outputTreasureLoc, outputMsg; inputs reset: Boolean, xBound: Double, yBound: Double
# ---------- c_script: C# usings ----------
using TreasureHunt;
# ---------- c_script: C# ----------
    if (reset || StaticGame == null)
    {


      // Initialize the static game
      StaticGame = new Game(xBound, yBound);

      // Generate and initialize the players
      Random random = new Random(7897999);

      double randomX;
      double randomY;


      randomX = random.NextDouble() * xBound;
      randomY = random.NextDouble() * yBound;
      // Instantiate a moving ball
      Player player1 = new Player(randomX, randomY);
      // Add it to the list of balls belonging to the space.
      StaticGame.playerList.Add(player1);

      randomX = random.NextDouble() * xBound;
      randomY = random.NextDouble() * yBound;
      // Instantiate a moving ball
      HugoFollower player2 = new HugoFollower(player1);
      
      //TinPlayer player2 = new TinPlayer(randomX, randomY);
      // Add it to the list of balls belonging to the space.
      StaticGame.playerList.Add(player2);


    }

    StaticGame.UpdatePlayers();

    List<Vector3d> playerLocations = new List<Vector3d>();

    for (int i = 0; i < StaticGame.playerList.Count; i++){
      playerLocations.Add(StaticGame.playerList[i].GetLocation());

    }

    List<string> playerMessages = new List<string>();

    for (int i = 0; i < StaticGame.playerList.Count; i++){
      playerMessages.Add(StaticGame.playerList[i].statusMessage);
    }

    Vector3d treasureLocation = StaticGame.treasure.GetLocation();
    outputTreasureLoc = treasureLocation;
    outputMsg = playerMessages;
    outputPlayerLoc = playerLocations;
# ---------- c_script: C# additional code ----------
  public static Game StaticGame {get;set;}
# ---------- end c_script ----------
pt = Point(c_script.outputPlayerLoc)
pt_2 = Point(c_script.outputTreasureLoc)
preview = CustomPreview(
    Geometry=pt_2,
    Material={diffuse=RGB(221, 160, 221), emission=RGB(66, 48, 66), shine=0.5, specular=RGB(255, 255, 255), transparency=0})
